vi "Animation Mixer.gvi"   [LabVIEW NXG 3.1.0]
inputs:
  "entity attributes in": "entity attributes.gtype"
outputs:
  "entity attributes out": "entity attributes.gtype"
types:
  "attribute.gtype" = cluster{"name": string, "valueJSON": string}
  "entity attributes.gtype" = "attribute.gtype"[]
uses:
  AugmentedReality::Support::Append Attribute.gvi
diagram:
  Flatten To JSON(anything=cluster{"data": string} {"data"="loop:repeat;timeScale:.5;"}) -> (JSON string=w1)
  call "Append Attribute.gvi"(entity attributes in=$"entity attributes in", name="animation-mixer", valueJSON=w1) -> (entity attributes out=w2)
  $"entity attributes out" <- w2
