vi "Text.gvi"   [LabVIEW NXG 3.1.0]
inputs:
  "entity attributes in": "entity attributes.gtype"
  "text": string, required
outputs:
  "entity attributes out": "entity attributes.gtype"
types:
  "attribute.gtype" = cluster{"name": string, "valueJSON": string}
  "entity attributes.gtype" = "attribute.gtype"[]
uses:
  AugmentedReality::Support::Append Attribute.gvi
diagram:
  w1 = cluster{"data": cluster{"value": string}} {all zero or empty}
  Property Node(instance in=w1, "data:value"=$text) -> (instance out=w2)
  Flatten To JSON(anything=w2) -> (JSON string=w3)
  call "Append Attribute.gvi"(entity attributes in=$"entity attributes in", name="text-geometry", valueJSON=w3) -> (entity attributes out=w4)
  $"entity attributes out" <- w4
