vi "index.gviweb"   [LabVIEW NXG 3.1.0]
panel controls:
  "Height Offset of Box": f64 = 0.5
  "Button": bool
  "Tab": i32
  "Hyperlink Control": string = "https://sketchfab.com/models/031875966a5740f18ac4cffa8b14031d#"
  "Hyperlink Control_2": string = "https://medium.com/arjs/augmented-reality-in-10-lines-of-html-4e193ea9fdbf"
  "stop": bool
panel indicators:
  "URL Image": string
  "Output": error
uses:
  Resources::Placeholder.gviweb
  AugmentedReality::Create Scene.gviweb
  AugmentedReality::Destroy Scene.gviweb
diagram:
  call "Placeholder.gviweb"()
  while {
    Wait(time to wait=10)
    stop if $Button
  }
  call "Create Scene.gviweb"(selector=".eagle-demo", error in=no error) -> (scene refnum=w1, error out=w2)
  s1 = w2  # shift register
  while {
    Wait(time to wait=10)
    stop if $stop
  }
  call "Destroy Scene.gviweb"(scene refnum=w1, error in=s1) -> (error out=w3)
  $Output <- w3
