vi "Create Navbar.gvi"   [LabVIEW NXG 4.0.0]
uses:
  Bootstrap::Set Brand.gvi
  Bootstrap::Append Nav Item.gvi
diagram:
  call "Set Brand.gvi"(text="My Company", url="https://www.google.com") -> (error out=w1)
  call "Append Nav Item.gvi"(text="home", url="index.html", error in=w1) -> (error out=w2)
  call "Append Nav Item.gvi"(text="cpu monitor", url="devices/cpu.html", error in=w2)
