vi "index.gviweb"   [G Web Development Software 22.3.0]
panel controls:
  "tab": i32
  "tab selector visible?": bool = TRUE
  "listbox": i32 = -1
  "color absolute link": string = "backgrounds/color-absolute.html"
  "color flexible link": string = "backgrounds/color-flexible.html"
  "Gadient flexible link": string = "backgrounds/gradient-flexible.html"
  "Gadient absolute link": string = "backgrounds/gradient-absolute.html"
  "Plain absolute link": string = "backgrounds/plain-absolute.html"
  "Plain flexible link": string = "backgrounds/plain-flexible.html"
  "tree column width": u32 = 100
  "data grid column sorting": enum{"none", "ascending", "descending"} = "none"
  "button": bool
  "numeric slider": f64 = 5
  "numeric set minimum": f64
  "numeric set maximum": f64 = 10
  "data grid column grouping": enum{"none", "by color", "by farm then color"} = "none"
  "enable arrow?": bool
  "Gauge": f64 = 3.4098059503
panel indicators:
  "tree": cluster{"location": string}[]
  "data grid": T1[]
  "numeric gauge": f64
  "numeric tank": f64
  "numeric linear progress bar": f64
  "numeric radial progress bar": f64
types:
  T1 = cluster{"Food": string, "Color": string, "Farm": string}
uses:
  ControlExtensions::Data Grid - Column by Index - Set Sorting.gvi
  WebApp::Support::Show Error Dialog.gvi
  ControlExtensions::Tab - Selector - Visible.gvi
  ControlExtensions::Tree - Column - Set Width.gvi
  ControlExtensions::Numeric - Scale - Set Maximum.gvi
  ControlExtensions::Numeric - Scale - Set Minimum.gvi
  ControlExtensions::Data Grid - Column by Index - Set Gouping.gvi
  ControlExtensions::Gauge - Needle - Set Arrow.gvi
  ControlExtensions::Button - Glyph - Create Image URL Style.gvi
  ControlExtensions::Listbox - Items - Enable Tooltip.gvi
  ControlExtensions::Tree - Cells - Enable Tooltip.gvi
diagram:
  while {
    event {
      on "data grid column sorting" Value changed {
        Event Data() -> ("New Value"=w1)
        call "Data Grid - Column by Index - Set Sorting.gvi"(reference in=reference to "data grid", column index=0, sort=w1) -> (error out=w2)
        call "Show Error Dialog.gvi"(error in=w2)
      }
      on "tab selector visible?" Value changed {
        Event Data() -> ("New Value"=w3)
        call "Tab - Selector - Visible.gvi"(reference in=reference to "tab", visible?=w3) -> (error out=w4)
        call "Show Error Dialog.gvi"(error in=w4)
      }
      on "tree column width" Value changed {
        Event Data() -> ("New Value"=w5)
        call "Tree - Column - Set Width.gvi"(reference in=reference to "tree", column index=0, width=w5) -> (error out=w6)
        call "Show Error Dialog.gvi"(error in=w6)
      }
      on "numeric set maximum" Value changed {
        Event Data() -> ("New Value"=w7)
        call "Numeric - Scale - Set Maximum.gvi"(reference in=reference to "numeric radial progress bar", maximum=w7) -> (error out=w8)
        call "Show Error Dialog.gvi"(error in=w8)
        call "Numeric - Scale - Set Maximum.gvi"(reference in=reference to "numeric tank", maximum=w7) -> (error out=w9)
        call "Show Error Dialog.gvi"(error in=w9)
        call "Numeric - Scale - Set Maximum.gvi"(reference in=reference to "numeric linear progress bar", maximum=w7) -> (error out=w10)
        call "Show Error Dialog.gvi"(error in=w10)
        call "Numeric - Scale - Set Maximum.gvi"(reference in=reference to "numeric slider", maximum=w7) -> (error out=w11)
        call "Show Error Dialog.gvi"(error in=w11)
        call "Numeric - Scale - Set Maximum.gvi"(reference in=reference to "numeric gauge", maximum=w7) -> (error out=w12)
        call "Show Error Dialog.gvi"(error in=w12)
      }
      on "numeric set minimum" Value changed {
        Event Data() -> ("New Value"=w13)
        call "Numeric - Scale - Set Minimum.gvi"(reference in=reference to "numeric radial progress bar", minimum=w13) -> (error out=w14)
        call "Show Error Dialog.gvi"(error in=w14)
        call "Numeric - Scale - Set Minimum.gvi"(reference in=reference to "numeric tank", minimum=w13) -> (error out=w15)
        call "Show Error Dialog.gvi"(error in=w15)
        call "Numeric - Scale - Set Minimum.gvi"(reference in=reference to "numeric linear progress bar", minimum=w13) -> (error out=w16)
        call "Show Error Dialog.gvi"(error in=w16)
        call "Numeric - Scale - Set Minimum.gvi"(reference in=reference to "numeric slider", minimum=w13) -> (error out=w17)
        call "Show Error Dialog.gvi"(error in=w17)
        call "Numeric - Scale - Set Minimum.gvi"(reference in=reference to "numeric gauge", minimum=w13) -> (error out=w18)
        call "Show Error Dialog.gvi"(error in=w18)
      }
      on "data grid column grouping" Value changed {
        Event Data() -> ("New Value"=w19)
        case (w19) {
          frame "none" {
            w20 = u32[] []
          }
          frame "by color" {
            w20 = [1]
          }
          frame "by farm then color" {
            w20 = [2, 1]
          }
        }
        call "Data Grid - Column by Index - Set Gouping.gvi"(reference in=reference to "data grid", column indexes=w20) -> (error out=w21)
        call "Show Error Dialog.gvi"(error in=w21)
      }
      on "enable arrow?" Value changed {
        Event Data() -> ("New Value"=w22)
        call "Gauge - Needle - Set Arrow.gvi"(reference in=reference to "Gauge", enabled=w22) -> (error out=w23)
        call "Show Error Dialog.gvi"(error in=w23)
      }
    }
    stop if FALSE
  }
  call "Button - Glyph - Create Image URL Style.gvi"(reference in=reference to "button", url="Support/lightbulb.svg") -> (error out=w24)
  call "Show Error Dialog.gvi"(error in=w24)
  call "Listbox - Items - Enable Tooltip.gvi"(reference in=reference to "listbox") -> (error out=w25)
  call "Show Error Dialog.gvi"(error in=w25)
  call "Tree - Cells - Enable Tooltip.gvi"(reference in=reference to "tree") -> (error out=w26)
  call "Show Error Dialog.gvi"(error in=w26)
