vi "index.gviweb"   [LabVIEW NXG 5.1.0]
panel controls:
  "sort": enum{"none", "ascending", "descending"} = "none"
  "Listbox": i32 = -1
  "update listbox": bool
panel indicators:
  "Data Grid": T1[]
types:
  T1 = cluster{"Some Value": string, "Some Other Value": string}
uses:
  ControlTools::Listbox - Item - Enable Tooltip.gvi
  ControlTools::DataGrid - Column - Set Sorting.gvi
  WebApp::Support::Show Error Dialog.gvi
diagram:
  # For instructions configuring the selector input follow the Choosing a control in the page portion of: https://forums.ni.com/t5/Example-Code/Declarative-Style-for-WebVI/ta-p/4141973
  call "Listbox - Item - Enable Tooltip.gvi"(selector=".my-listbox")
  w1 = [{"Some Value"="b", "Some Other Value"="z"}, {"Some Value"="c", "Some Other Value"="y"}, {"Some Value"="d", "Some Other Value"="x"}, {"Some Value"="a", "Some Other Value"="w"}]
  $"Data Grid" <- w1
  while (iteration -> i1) {
    event {
      on "sort" Value changed {
        # For instructions configuring the selector input follow the Choosing a control in the page portion of: https://forums.ni.com/t5/Example-Code/Declarative-Style-for-WebVI/ta-p/4141973
        Event Data() -> ("New Value"=w2)
        call "DataGrid - Column - Set Sorting.gvi"(selector=".my-grid", column index=0, sort=w2) -> (error out=w3)
        call "Show Error Dialog.gvi"(error in=w3)
      }
      on "update listbox" Value changed {
        for (N = 100) (iteration -> i2) {
          Format Into String(formatString="%d - %d - %s", i2, i1, "a long string that needs a tooltip ") -> w5
          append w5 to w4
        }
        Property Node(instance in=reference to "Listbox", "Items"=w4)
      }
    }
    stop if FALSE
  }
