vi "index.gviweb"   [LabVIEW NXG 3.1.0]
panel indicators:
  "name": string[]
  "value": string[]
  "found": bool[]
  "name_2": string[]
  "value_2": string[]
  "found_2": bool[]
  "iframe load time": timestamp
  "iframe load time_2": timestamp
uses:
  DOM::Search::Query Selectors.gvi
  DOM::Build::Create Document Fragment.gvi
  DOM::Build::Append Children.gvi
  DOM::Shared::Append Attribute Value Config.gvi
  DOM::Configure::Set Attributes.gvi
  DOM::Configure::Get Attributes.gvi
  DOM::Monitor::Add Event Listener.gvi
  DOM::Monitor::Wait For Event.gvi
  DOM::Monitor::Remove Event Listener.gvi
  DOM::Tasks::Select Element and Append Content.gvi
diagram:
  Build Array(".placeholder") -> w1
  call "Query Selectors.gvi"(selectors=w1) -> (element references=w2)
  Array Index(array=w2) -> (out0[_]=w3)
  # Top-Level WebVIs usually contain a While Loop that never stops so that they can continue running as long as the web page is open in the user's web browser.
  while (after w3) {
    Wait(time to wait=50)
    stop if FALSE
  }
  call "Create Document Fragment.gvi"(content="<iframe random=\"lol\"></iframe>") -> (document fragment reference=w4)
  Build Array(w4) -> w5
  call "Append Children.gvi"(parent reference=w3, child references=w5, clear parent content=TRUE)
  Build Array("src") -> w6
  call "Query Selectors.gvi"(dom target reference in (global document)=w4, selectors=["iframe"]) -> (element references=w7)
  Array Index(array=w7) -> (out0[_]=w8)
  call "Append Attribute Value Config.gvi"(attribute value="http://www.ni.com") -> (attribute value configs out=w9)
  call "Set Attributes.gvi"(element reference in=w8, attribute names=w6, attribute value configs=w9) -> (element reference out=w10)
  call "Get Attributes.gvi"(element reference in=w10) -> (attribute names out=w11, attribute values out=w12, attribute exist out=w13)
  $name <- w11
  $value <- w12
  $found <- w13
  call "Get Attributes.gvi"(element reference in=w10, attribute names in=["random", "fakenews"]) -> (attribute names out=w14, attribute values out=w15, attribute exist out=w16)
  $name_2 <- w14
  $value_2 <- w15
  $found_2 <- w16
  call "Add Event Listener.gvi"(element reference in=w10, event name="load") -> (event manager reference=w17, error out=w18)
  call "Wait For Event.gvi"(event manager reference in=w17, error in=w18) -> (event manager reference out=w19, error out=w20)
  sequence {
    frame 0 {
      Get Current Time() -> (current time=w21)
      $"iframe load time" <- w21
    }
  }
  call "Remove Event Listener.gvi"(event manager reference=w19, error in=w20)
  call "Create Document Fragment.gvi"(content="<iframe src=\"https://www.reddit.com\"></iframe>") -> (document fragment reference=w22, error out=w23)
  call "Query Selectors.gvi"(dom target reference in (global document)=w22, selectors=["iframe"], error in=w23) -> (element references=w24, error out=w25)
  Array Index(array=w24) -> (out0[_]=w26)
  call "Add Event Listener.gvi"(element reference in=w26, event name="load", error in=w25) -> (element reference out=w27, event manager reference=w28, error out=w29)
  call "Select Element and Append Content.gvi"(parent selector=".placeholder2", dom reference=w27, clear parent content=TRUE, error in=w29) -> (error out=w30)
  call "Wait For Event.gvi"(event manager reference in=w28, error in=w30) -> (property value configs=w31)
  sequence (after w31) {
    frame 0 {
      Get Current Time() -> (current time=w32)
      $"iframe load time_2" <- w32
    }
  }
