vi "svg.gviweb"   [LabVIEW NXG 4.0.0]
uses:
  DOM::Search::Query Selector All.gvi
  DOM::Build::Create Document Fragment.gvi
  DOM::Build::Append Children.gvi
  DOM::Build::Create Elements.gvi
  DOM::Values::Append Attribute.gvi
  DOM::Configure::Set Attributes and Properties.gvi
diagram:
  call "Query Selector All.gvi"(selector=".placeholder") -> (element references=w1)
  Array Index(array=w1) -> (out0[_]=w2)
  w3 = """<svg height="100" width="100">
  <circle cx="50" cy="50" r="40" stroke="black" stroke-width="3" fill="red" />
  <image xlink:href="https://mdn.mozillademos.org/files/6457/mdn_logo_only_color.png" height="200" width="200"/>
</svg>"""
  call "Create Document Fragment.gvi"(content=w3) -> (document fragment reference=w4)
  Build Array(w4) -> w5
  call "Append Children.gvi"(parent reference in=w2, child references=w5, clear parent content=TRUE)
  call "Query Selector All.gvi"(selector=".placeholder2") -> (element references=w6)
  Array Index(array=w6) -> (out0[_]=w7)
  call "Create Elements.gvi"(tag names=["svg"]) -> (element references=w8)
  Array Index(array=w8) -> (out0[_]=w9)
  call "Append Attribute.gvi"(name="height", value="100") -> (dom values out=w10)
  call "Append Attribute.gvi"(dom values in=w10, name="width", value="100") -> (dom values out=w11)
  call "Set Attributes and Properties.gvi"(element reference in=w9, dom values=w11) -> (element reference out=w12)
  # Todo can't use setAttribute because need xlink namespace, this is a workaround
  # Todo can't use createElement because need a way to pass the namespace, this is a workaround
  call "Create Document Fragment.gvi"(content="<svg><image xlink:href=\"\"/></svg>") -> (document fragment reference=w13)
  call "Query Selector All.gvi"(dom target reference in (global document)=w13, selector="image") -> (element references=w14)
  Array Index(array=w14) -> (out0[_]=w15)
  w16 = "https://mdn.mozillademos.org/files/6457/mdn_logo_only_color.png"
  call "Append Attribute.gvi"(name="width", value="200") -> (dom values out=w17)
  call "Append Attribute.gvi"(dom values in=w17, name="height", value="200") -> (dom values out=w18)
  call "Append Attribute.gvi"(dom values in=w18, name="xlink:href", value=w16) -> (dom values out=w19)
  call "Set Attributes and Properties.gvi"(element reference in=w15, dom values=w19) -> (element reference out=w20)
  # This works because the circle element is created inside an svg context in the document fragment. If it was created outside via createElements or as a circle tag standalone it would be in the html context and fail to work.
  call "Create Document Fragment.gvi"(content="<svg><circle/></svg>") -> (document fragment reference=w21)
  call "Query Selector All.gvi"(dom target reference in (global document)=w21, selector="circle") -> (element references=w22)
  Array Index(array=w22) -> (out0[_]=w23)
  # Todo can't use createElement because need a way to pass the namespace, this is a workaround
  call "Append Attribute.gvi"(name="cx", value="50") -> (dom values out=w24)
  call "Append Attribute.gvi"(dom values in=w24, name="cy", value="50") -> (dom values out=w25)
  call "Append Attribute.gvi"(dom values in=w25, name="r", value="40") -> (dom values out=w26)
  call "Append Attribute.gvi"(dom values in=w26, name="stroke", value="black") -> (dom values out=w27)
  call "Append Attribute.gvi"(dom values in=w27, name="stroke-width", value="3") -> (dom values out=w28)
  call "Append Attribute.gvi"(dom values in=w28, name="fill", value="red") -> (dom values out=w29)
  call "Append Attribute.gvi"(dom values in=w29, name="pathLength", value="7") -> (dom values out=w30)
  call "Set Attributes and Properties.gvi"(element reference in=w23, dom values=w30) -> (element reference out=w31)
  Build Array(w31, w20) -> w32
  call "Append Children.gvi"(parent reference in=w12, child references=w32) -> (parent reference out=w33)
  Build Array(w33) -> w34
  call "Append Children.gvi"(parent reference in=w7, child references=w34, clear parent content=TRUE)
  while {
    stop if FALSE
  }
