vi "index.gviweb"   [LabVIEW NXG 5.1.0]
panel controls:
  "stop": bool
panel indicators:
  "Data Grid": cluster{"A": string, "String": string}[]
types:
  "operator.gtype" = enum{"exact match", "starts with", "ends with", "contains"}
  "text match options.gtype" = cluster{"operator": "operator.gtype", "text": string, "case-insensitive": bool}
uses:
  DeclarativeStyle::Selector::DataGrid - String Column - Text Match.gvi
  DeclarativeStyle::Property::Background Color.gvi
  DeclarativeStyle::Create Style.gvi
  DeclarativeStyle::Property::Custom Property.gvi
  DeclarativeStyle::Property::Font Color.gvi
  DeclarativeStyle::Remove Style.gvi
  WebApp::Support::Show Error Dialog.gvi
diagram:
  w1 = [{"A"="fail", "String"="fail"}, {"A"="pass", "String"="pass"}]
  $"Data Grid" <- w1
  w2 = "text match options.gtype" {"operator"="exact match", "text"="pass", "case-insensitive"=FALSE}
  call "DataGrid - String Column - Text Match.gvi"(selector=".my-element", column index=0, text match options=w2) -> (rule selector=w3)
  call "Background Color.gvi"(background color=1711318607) -> (rule properties out=w4)
  call "Create Style.gvi"(rule selector=w3, rule properties=w4) -> (style reference=w5, error out=w6)
  w7 = "text match options.gtype" {"operator"="exact match", "text"="fail", "case-insensitive"=FALSE}
  call "DataGrid - String Column - Text Match.gvi"(selector=".my-element", column index=1, text match options=w7) -> (rule selector=w8)
  w9 = "linear-gradient( -10deg, #f10d5e 0%, #ffb43e 25%, #43e03c 50%, #6528ff 100%);"
  call "Custom Property.gvi"(name="background-image", value=w9) -> (rule properties out=w10)
  call "Font Color.gvi"(rule properties in=w10, font color=4294967295) -> (rule properties out=w11)
  call "Create Style.gvi"(rule selector=w8, rule properties=w11) -> (style reference=w12, error out=w13)
  while {
    Wait(time to wait=50)
    stop if $stop
  }
  call "Remove Style.gvi"(style reference=w5, error in=w6) -> (error out=w14)
  call "Show Error Dialog.gvi"(error in=w14)
  call "Remove Style.gvi"(style reference=w12, error in=w13) -> (error out=w15)
  call "Show Error Dialog.gvi"(error in=w15)
