vi "main.gviweb"   [G Web Development Software 22.3.0]
uses:
  Deno::Environment Variable Get.gvi
  Deno::Current Working Directory Get.gvi
  URL::URL::URL Build Relative Path.gvi
  DenoKV::KV Open.gvi
  DenoHTTP::Simple URL Pattern.gvi
  DenoHTTP::HTTP Create Listeners.gvi
  DenoHTTP::HTTP Wait On Listener.gvi
  DenoHTTP::HTTP Read Request Body String.gvi
  DenoKV::KV Monotonic ULID.gvi
  DenoKV::KV Set String.gvi
  DenoHTTP::HTTP Write Response.gvi
  DenoKV::KV List String.gvi
  DenoHTTP::HTTP Serve Files.gvi
  ChatServer::Support::Simple Log Error.gvi
diagram:
  call "Environment Variable Get.gvi"(name="DENO_DEPLOYMENT_ID") -> (error out=w1)
  case (w1) {
    frame Error, Default {
      # running on deno deploy
      w2 = ""
    }
    frame No Error {
      # running locally
      call "Current Working Directory Get.gvi"() -> (current working directory url=w3)
      call "URL Build Relative Path.gvi"(base url (window location)=w3, relative url="./chat.db") -> (url=w2)
    }
  }
  call "KV Open.gvi"(path url=w2) -> (kv reference=w4, error out=w5)
  call "Simple URL Pattern.gvi"(pathname="/message") -> (url pattern=w6)
  call "Simple URL Pattern.gvi"() -> (url pattern=w7)
  Build Array(w6, w7) -> w8
  call "HTTP Create Listeners.gvi"(url patterns=w8) -> (http listener references=w9, error out=w10)
  Array Index(array=w9) -> (out0[_]=w11, out1[_]=w12)
  while {
    call "HTTP Wait On Listener.gvi"(http listener reference=w11, error in=w5) -> (http connection reference=w13, error out=w14, method=w15)
    case (w15) {
      frame "POST" {
        call "HTTP Read Request Body String.gvi"(http connection reference in=w13, error in=w14) -> (http connection reference out=w16, body=w17, error out=w18)
        call "KV Monotonic ULID.gvi"(error in=w18) -> (monotonic ulid=w19, error out=w20)
        Build Array("messages", w19) -> w21
        call "KV Set String.gvi"(kv reference in=w4, key=w21, value=w17, error in=w20) -> (error out=w22)
        call "HTTP Write Response.gvi"(http connection reference=w16, body="saved", error in=w22)
      }
      frame Default { }
      frame "GET" {
        Build Array("messages") -> w23
        call "KV List String.gvi"(kv reference in=w4, key=w23, limit=20, error in=w14) -> (values=w24, error out=w25)
        Flatten To Json(anything=w24, error in (no error)=w25) -> (JSON string=w26, error out=w27)
        call "HTTP Write Response.gvi"(http connection reference=w13, body=w26, error in=w27)
      }
    }
    stop if FALSE
  }
  call "Current Working Directory Get.gvi"() -> (current working directory url=w28)
  call "URL Build Relative Path.gvi"(base url (window location)=w28, relative url="./Builds/ChatClient_Default Web Server/") -> (url=w29)
  call "HTTP Serve Files.gvi"(http listener reference=w12, root path url=w29, error in=w10) -> (error out=w30)
  call "Simple Log Error.gvi"(error In=w30)
