vi "main.gviweb"   [G Web Development Software 22.3.0]
uses:
  DenoHTTP::Create URL Pattern.gvi
  DenoHTTP::Support::DenoHTTP.jsli::StartServer
  DenoHTTP::Listen for Request.gvi
  WebApp::Support::WebSocket Echo Test.gvi
  DenoHTTP::Complete Request.gvi
  WebApp::Support::Simple Log Error.gvi
  DenoHTTP::Support::DenoHTTP.jsli::RequestUrl
  URL::URL::URL Parameters::URL Get Search Parameter.gvi
  Deno::Support::Deno.jsli::Deno env get
  WebApp::Support::Update Tag.gvi
  DenoHTTP::Support::DenoHTTP.jsli::ServeFileRequests
diagram:
  call "Create URL Pattern.gvi"(pathname="/websocket") -> (url pattern=w1)
  call "Create URL Pattern.gvi"(pathname="/api/systemlink") -> (url pattern=w2)
  call "Create URL Pattern.gvi"(pathname="*") -> (url pattern=w3)
  Build Array(w1, w2, w3) -> w4
  Flatten To Json(anything=w4) -> (JSON string=w5, error out=w6)
  call "StartServer"(urlPatternConfigsJSON=w5, error in=w6) -> (requestListeners=w7, error out=w8)
  Array Index(array=w7) -> (out0[_]=w9, out1[_]=w10, out2[_]=w11)
  s1 = w8  # shift register
  while (iteration -> i1) {
    call "Listen for Request.gvi"(request listener=w9, error in=s1) -> (request handler=w12, error out=w13)
    call "WebSocket Echo Test.gvi"(error in=w13) -> (error out=w14)
    Format Into String(formatString="done iteration %d", errIn=w14, i1) -> (outString=w15, errOut=w16)
    call "Complete Request.gvi"(request handler=w12, body=w15, error in=w16) -> (error out=w17)
    next s1 = w17
    stop if w17
  }
  call "Simple Log Error.gvi"(error In=s1)
  s2 = w8  # shift register
  while {
    call "Listen for Request.gvi"(request listener=w10, error in=s2) -> (request handler=w18, error out=w19)
    call "RequestUrl"(requestHandler=w18, error in=w19) -> (url=w20, error out=w21)
    call "URL Get Search Parameter.gvi"(url=w20, key="tag-value", error in=w21) -> (value=w22, error out=w23)
    call "Deno env get"(arg="deno-sl-cloud-key") -> (return=w24, error out=w25)
    case (w25) {
      frame Error, Default {
        Concatenate Strings("tag update skipped value:", w22) -> w27
        w26 = w23
      }
      frame No Error {
        call "Update Tag.gvi"(api key=w24, value=w22, error in=w23) -> (error out=w26)
        Concatenate Strings("updated tag value:", w22) -> w27
      }
    }
    call "Complete Request.gvi"(request handler=w18, body=w27, error in=w26) -> (error out=w28)
    next s2 = w28
    stop if w28
  }
  call "Simple Log Error.gvi"(error In=s2)
  call "ServeFileRequests"(requestListener=w11, relativeUrlFromWebAppRoot=".", error in=w8) -> (error out=w29)
  call "Simple Log Error.gvi"(error In=w29)
