vi "Create EChart.gvi"   [LabVIEW NXG 3.1.0]
inputs:
  "selector": string, required
  "error in": error
outputs:
  "error out": error
  "echart reference": "echart reference.gtype"
types:
  "echart reference.gtype" = i32
uses:
  ECharts::Shared Options::Set Animation Options.gvi
  ECharts::Shared Options::Set Color Options.gvi
  ECharts::Shared Options::Set Text Style Options.gvi
  ECharts::Support::ECharts.jsli::CreateEChart
  ECharts::Core::Update EChart Options.gvi
diagram:
  w1 = [4286191129, 4278882018, 4292982147, 4290161445, 4289584110, 4288645807, 4286479998, 4282058533]
  call "Set Animation Options.gvi"(animation?=FALSE) -> (echart options out=w2)
  call "Set Color Options.gvi"(echart options in=w2, color=w1) -> (echart options out=w3)
  # Create the echart and set defaults. This will disable animations by default, use an NXG color palette, and NXG default fonts.
  call "Set Text Style Options.gvi"(echart options in=w3, color=4281020467, font family="Segoe UI", font size=9) -> (echart options out=w4)
  call "CreateEChart"(selector=$selector, error in=$"error in") -> (echart reference=w5, error out=w6)
  call "Update EChart Options.gvi"(echart reference in=w5, error in=w6, echart options=w4) -> (echart reference out=w7, error out=w8)
  $"echart reference" <- w7
  $"error out" <- w8
