vi "Update EChart Options.gvi"   [LabVIEW NXG 3.1.0]
inputs:
  "echart reference in": "echart reference.gtype", required
  "echart options": "echart options.gtype", required
  "error in": error
outputs:
  "error out": error
  "echart reference out": "echart reference.gtype"
types:
  "echart reference.gtype" = i32
  "option.gtype" = cluster{"name": string, "propertiesJSON": string}
  "echart options.gtype" = "option.gtype"[]
uses:
  ECharts::Support::ECharts.jsli::UpdateEChart
diagram:
  $"echart reference out" <- $"echart reference in"
  Flatten To JSON(anything=$"echart options") -> (JSON string=w1)
  call "UpdateEChart"(echart reference=$"echart reference in", options array json=w1, error in=$"error in") -> (error out=w2)
  $"error out" <- w2
