vi "index.gviweb"   [LabVIEW NXG 3.1.0]
panel indicators:
  "URL Image": string
  "URL Image_2": string
uses:
  ECharts::Core::Create EChart.gvi
  ECharts::Shared Options 3D::Set Grid 3D.gvi
  ECharts::Shared Options 3D::Set Axis 3D.gvi
  ECharts::Core::Update EChart Options.gvi
  WebApp::Generate Pie Data.gvi
  ECharts::Pie Options::Append Pie Series Options.gvi
  WebApp::Generate Surface Data.gvi
  ECharts::Surface Options::Append Surface Series Options.gvi
  ECharts::Core::Destroy EChart.gvi
diagram:
  call "Create EChart.gvi"(selector=".my-pie-chart") -> (echart reference=w1, error out=w2)
  call "Create EChart.gvi"(selector=".my-scatter-chart") -> (echart reference=w3, error out=w4)
  call "Set Grid 3D.gvi"() -> (echart options out=w5)
  call "Set Axis 3D.gvi"(echart options in=w5, axis 3d="x") -> (echart options out=w6)
  call "Set Axis 3D.gvi"(echart options in=w6, axis 3d="y") -> (echart options out=w7)
  call "Set Axis 3D.gvi"(echart options in=w7, axis 3d="z") -> (echart options out=w8)
  call "Update EChart Options.gvi"(echart reference in=w3, error in=w4, echart options=w8) -> (echart reference out=w9, error out=w10)
  s1 = w2  # shift register
  s2 = w10  # shift register
  while {
    Wait(time to wait=10)
    call "Generate Pie Data.gvi"() -> (pie data=w11)
    call "Append Pie Series Options.gvi"(data=w11) -> (echart options out=w12)
    call "Update EChart Options.gvi"(echart reference in=w1, error in=s1, echart options=w12) -> (echart reference out=w13, error out=w14)
    call "Generate Surface Data.gvi"() -> (Output=w15)
    call "Append Surface Series Options.gvi"(data=w15) -> (echart options out=w16)
    call "Update EChart Options.gvi"(echart reference in=w9, error in=s2, echart options=w16) -> (echart reference out=w17, error out=w18)
    Merge Errors(w14, w18) -> (error out=w19)
    next s1 = w14
    next s2 = w18
    stop if w19
  }
  call "Destroy EChart.gvi"(echart reference=w13, error in=s1)
  call "Destroy EChart.gvi"(echart reference=w17, error in=s2)
