vi "Add Keyboard Event Listener.gvi"   [LabVIEW NXG 5.0.0]
inputs:
  "error in": error
  "prevent default": bool
  "keyboard event type": "keyboard event type.gtype" = "keydown", required
  "target": "NI.JavaScriptReference", required
outputs:
  "event manager reference": "event manager reference.gtype"
  "error out": error
types:
  "keyboard event type.gtype" = enum{"keydown", "keyup"}
  "event manager reference.gtype" = "NI.JavaScriptReference"
uses:
  EventTarget::Support::EventTarget.jsli::AddKeyboardEventListener
diagram:
  Format Into String(errIn=$"error in", $"keyboard event type") -> (outString=w1, errOut=w2)
  call "AddKeyboardEventListener"(target=$target, eventName=w1, preventDefault=$"prevent default", error in=w2) -> (eventStreamReader=w3, error out=w4)
  $"event manager reference" <- w3
  $"error out" <- w4
