vi "index.gviweb"   [LabVIEW NXG 5.0.0]
panel controls:
  "Keyboard event on specific elements": string
panel indicators:
  "code": string
  "key": string
  "error out": error
  "code specific element": string
  "key specific element": string
  "error out specific element": error
uses:
  EventTarget::Get Target::Get Target - Document.gvi
  EventTarget::Keyboard::Add Keyboard Event Listener.gvi
  EventTarget::Keyboard::Listen For Keyboard Events.gvi
  EventTarget::Remove Event Listener.gvi
  EventTarget::Get Target::Get Target - Selector.gvi
diagram:
  call "Get Target - Document.gvi"() -> (document=w1, error out=w2)
  call "Add Keyboard Event Listener.gvi"(target=w1, keyboard event type="keydown", error in=w2) -> (event manager reference=w3, error out=w4)
  s1 = w4  # shift register
  while {
    call "Listen For Keyboard Events.gvi"(event manager reference in=w3, error in=s1) -> (event manager reference out=w5, code=w6, key=w7, error out=w8)
    $code <- w6
    $key <- w7
    next s1 = w8
    stop if w8
  }
  call "Remove Event Listener.gvi"(event manager reference=w5, error in=s1) -> (error out=w9)
  Close Reference(error in=w9, reference=w1) -> (error out=w10)
  $"error out" <- w10
  call "Get Target - Selector.gvi"(selector=".my-element") -> (element=w11, error out=w12)
  call "Add Keyboard Event Listener.gvi"(target=w11, keyboard event type="keydown", error in=w12) -> (event manager reference=w13, error out=w14)
  s2 = w14  # shift register
  while {
    call "Listen For Keyboard Events.gvi"(event manager reference in=w13, error in=s2) -> (event manager reference out=w15, code=w16, key=w17, error out=w18)
    $"code specific element" <- w16
    $"key specific element" <- w17
    next s2 = w18
    stop if w18
  }
  call "Remove Event Listener.gvi"(event manager reference=w15, error in=s2) -> (error out=w19)
  Close Reference(error in=w19, reference=w11) -> (error out=w20)
  $"error out specific element" <- w20
