vi "index.gviweb"   [LabVIEW NXG 5.0.0]
panel controls:
  "capture image": bool
  "load text": bool
  "text": string
  "save text": bool
  "text file name": string
  "load binary": bool
  "binary file name": string
  "save binary": bool
panel indicators:
  "image blob url": string
  "number of bytes": i32
  "number of bytes (base64 encoded)": i32
  "image data uri": string
uses:
  File::File Url::Close File Url.gvi
  WebApp::Support::Show Error Dialog.gvi
  FileTasks::Capture Image as File.gvi
  File::File Url::Create File Url.gvi
  File::Read File.gvi
  File::Close File.gvi
  Base64::Create Data Url.gvi
  FileTasks::Read File Text.gvi
  FileTasks::Download File Text.gvi
  FileTasks::Read File Binary.gvi
  Base64::Base64 Encode.gvi
  Base64::Base64 Decode.gvi
  FileTasks::Download File Binary.gvi
diagram:
  s1 = ""  # shift register
  s2 = ""  # shift register
  while {
    event {
      on "capture image" Value changed {
        case (s1) {
          frame Default {
            # cleanup previous snapshot
            call "Close File Url.gvi"(url=s1) -> (error out=w3)
            call "Show Error Dialog.gvi"(error in=w3)
          }
          frame "" { }
        }
        Build Array("image/jpeg") -> w4
        call "Capture Image as File.gvi"(allowed file types=w4) -> (file reference=w5, error out=w6)
        call "Create File Url.gvi"(file reference in=w5, error in=w6) -> (file reference out=w7, file object url=w1, error out=w8)
        $"image blob url" <- w1
        call "Read File.gvi"(file reference in=w7, error in=w8) -> (file reference out=w9, file contents=w10, error out=w11)
        call "Close File.gvi"(file reference=w9, error in=w11) -> (error out=w12)
        call "Show Error Dialog.gvi"(error in=w12)
        call "Create Data Url.gvi"(data=w10, content type="image/jpeg", error in=w11) -> (data url=w13, error out=w14)
        $"image data uri" <- w13
        call "Show Error Dialog.gvi"(error in=w14)
        w2 = s2
      }
      on "load text" Value changed {
        call "Read File Text.gvi"(allowed file types=[".txt"]) -> (file content=w15, file name=w16, error out=w17)
        $text <- w15
        $"text file name" <- w16
        call "Show Error Dialog.gvi"(error in=w17)
        w1 = s1
        w2 = s2
      }
      on "save text" Value changed {
        call "Download File Text.gvi"(file contents=$text, file name=$"text file name") -> (error out=w18)
        call "Show Error Dialog.gvi"(error in=w18)
        w1 = s1
        w2 = s2
      }
      on "load binary" Value changed {
        call "Read File Binary.gvi"() -> (file contents=w19, file name=w20, error out=w21)
        Array Size(array=w19) -> (size(s)=w22)
        $"number of bytes" <- w22
        call "Base64 Encode.gvi"(data=w19, error in=w21) -> (encoded data=w2, error out=w23)
        String Length(string=w2) -> (length=w24)
        $"number of bytes (base64 encoded)" <- w24
        call "Show Error Dialog.gvi"(error in=w23)
        $"binary file name" <- w20
        w1 = s1
      }
      on "save binary" Value changed {
        call "Base64 Decode.gvi"(encoded data=s2) -> (data=w25, error out=w26)
        call "Download File Binary.gvi"(file contents=w25, file name=$"binary file name", error in=w26) -> (error out=w27)
        call "Show Error Dialog.gvi"(error in=w27)
        w1 = s1
        w2 = s2
      }
    }
    next s1 = w1
    next s2 = w2
    stop if FALSE
  }
