vi "index.gviweb"   [LabVIEW NXG 4.0.0]
panel controls:
  "index": i32
  "online": bool
  "offline": bool
panel indicators:
  "URL Image": string
uses:
  AFrame::Support::Include AFrame Dependencies.gvi
  DOM::Build::Create Document Fragment.gvi
  DOM::Search::Query Selector All.gvi
  AFrame::Scene::Create and Append Scene.gvi
  DOM::Build::Append Children.gvi
  AFrame::Entity Attributes::Text.gvi
  DOM::Configure::Create Style Attribute Value.gvi
  DOM::Values::Append Attribute.gvi
  DOM::Configure::Set Attributes and Properties.gvi
diagram:
  call "Include AFrame Dependencies.gvi"()
  w1 = """<a-gltf-model src="sts.glb" animation="property: rotation; to: 0 360 0; loop: true; dur: 10000; easing:easeInOutQuad" position="-2.5 0 -4"><a-entity text-geometry="value:offline" position="-1 1.5 0" material="color:red"></a-entity></a-gltf-model>
<a-gltf-model src="sts.glb" animation="property: rotation; to: 0 360 0; loop: true; dur: 10000; easing:easeInOutQuad"  position="0 0 -4"><a-entity text-geometry="value:offline" position="-1 1.5 0" material="color:red"></a-entity></a-gltf-model>
<a-gltf-model src="sts.glb" animation="property: rotation; to: 0 360 0; loop: true; dur: 10000; easing:easeInOutQuad"  position="2.5 0 -4"><a-entity text-geometry="value:offline" position="-1 1.5 0" material="color:red"></a-entity></a-gltf-model>"""
  call "Create Document Fragment.gvi"(content=w1, inert?=FALSE) -> (document fragment reference=w2)
  call "Query Selector All.gvi"(dom target reference in (global document)=w2, selector="a-entity[text-geometry]") -> (element references=w3, error out=w4)
  call "Create and Append Scene.gvi"(selector=".my-scene") -> (scene reference=w5)
  Build Array(w2) -> w6
  call "Append Children.gvi"(parent reference in=w5, child references=w6, error in=w4) -> (error out=w7)
  while (after w7) {
    event {
      on "online" Value changed {
        Array Index(array=w3) -> (out0[$index]=w8)
        call "Text.gvi"(text="online") -> (dom values out=w9)
        call "Create Style Attribute Value.gvi"(style property names=["color"], style property values=["green"]) -> (style attribute value=w10)
        call "Append Attribute.gvi"(dom values in=w9, name="material", value=w10) -> (dom values out=w11)
        call "Set Attributes and Properties.gvi"(element reference in=w8, dom values=w11)
      }
      on "offline" Value changed {
        Array Index(array=w3) -> (out0[$index]=w12)
        call "Text.gvi"(text="offline") -> (dom values out=w13)
        call "Create Style Attribute Value.gvi"(style property names=["color"], style property values=["red"]) -> (style attribute value=w14)
        call "Append Attribute.gvi"(dom values in=w13, name="material", value=w14) -> (dom values out=w15)
        call "Set Attributes and Properties.gvi"(element reference in=w12, dom values=w15)
      }
    }
    stop if FALSE
  }
