vi "Encode JSON.gvi"   [LabVIEW NXG 3.1.0]
inputs:
  "json tokens": "JSON Tokens.gtype"
outputs:
  "json string": string
types:
  "Type.gtype" = enum{"Array", "ArrayEnd", "ArrayDouble", "ArrayString", "ArrayBoolean", "Object", "ObjectKey", "ObjectEnd", "Double", "String", "True", "False", "Null"}
  "Token.gtype" = cluster{"type": "Type.gtype", "data": string, "offsets": i32[]}
  "JSON Tokens.gtype" = "Token.gtype"[]
uses:
  JSONParser::Support::Concatenate Separator.gvi
diagram:
  w1 = 0  # level
  s1 = ""  # shift register
  s2 = w1  # shift register
  for (iteration -> i1) {
    w2 = each element of $"json tokens"
    Increment(x=i1) -> w3
    Array Index(array=$"json tokens") -> (out0[w3]=w4)
    Property Node(instance in=w4) -> ("type"=w5)
    Property Node(instance in=w2) -> ("type"=w6, "data"=w7)
    case (w6) {
      frame "Array" {
        Concatenate Strings(s1, "[") -> w8
        Increment(x=s2) -> w9
      }
      frame "ArrayEnd" {
        Concatenate Strings(s1, "]") -> w10
        Decrement(x=s2) -> w9
        call "Concatenate Separator.gvi"(partial json string in=w10, next token type=w5, level=w9) -> (partial json string out=w8)
      }
      frame "ArrayDouble", "ArrayString", "ArrayBoolean" {
        Concatenate Strings(s1, w7) -> w11
        call "Concatenate Separator.gvi"(partial json string in=w11, next token type=w5, level=s2) -> (partial json string out=w8)
        w9 = s2
      }
      frame "Object" {
        Concatenate Strings(s1, "{") -> w8
        Increment(x=s2) -> w9
      }
      frame "ObjectKey" {
        Build Array(w7) -> w12
        # TODO: write a proper json string escape instead
        Flatten To JSON(anything=w12) -> (JSON string=w13)
        String Length(string=w13) -> (length=w14)
        Subtract(x=w14, y=2) -> w15
        String Subset(length (rest)=w15, offset (0)=1, string=w13) -> w16
        Concatenate Strings(s1, w16, ":") -> w8
        w9 = s2
      }
      frame "ObjectEnd" {
        Concatenate Strings(s1, "}") -> w17
        Decrement(x=s2) -> w9
        call "Concatenate Separator.gvi"(partial json string in=w17, next token type=w5, level=w9) -> (partial json string out=w8)
      }
      frame "Double" {
        Concatenate Strings(s1, w7) -> w18
        call "Concatenate Separator.gvi"(partial json string in=w18, next token type=w5, level=s2) -> (partial json string out=w8)
        w9 = s2
      }
      frame "String" {
        Build Array(w7) -> w19
        # TODO: write a proper json string escape instead
        Flatten To JSON(anything=w19) -> (JSON string=w20)
        String Length(string=w20) -> (length=w21)
        Subtract(x=w21, y=2) -> w22
        String Subset(length (rest)=w22, offset (0)=1, string=w20) -> w23
        Concatenate Strings(s1, w23) -> w24
        call "Concatenate Separator.gvi"(partial json string in=w24, next token type=w5, level=s2) -> (partial json string out=w8)
        w9 = s2
      }
      frame "True" {
        Concatenate Strings(s1, "true") -> w25
        call "Concatenate Separator.gvi"(partial json string in=w25, next token type=w5, level=s2) -> (partial json string out=w8)
        w9 = s2
      }
      frame "False" {
        Concatenate Strings(s1, "false") -> w26
        call "Concatenate Separator.gvi"(partial json string in=w26, next token type=w5, level=s2) -> (partial json string out=w8)
        w9 = s2
      }
      frame "Null" {
        Concatenate Strings(s1, "") -> w27
        call "Concatenate Separator.gvi"(partial json string in=w27, next token type=w5, level=s2) -> (partial json string out=w8)
        w9 = s2
      }
    }
    next s1 = w8
    next s2 = w9
  }
  $"json string" <- s1
