vi "Parse JSON.gvi"   [LabVIEW NXG 3.1.0]
inputs:
  "json string": string, required
  "error in": error
outputs:
  "json tokens": "JSON Tokens.gtype"
  "error out": error
types:
  "Type.gtype" = enum{"Array", "ArrayEnd", "ArrayDouble", "ArrayString", "ArrayBoolean", "Object", "ObjectKey", "ObjectEnd", "Double", "String", "True", "False", "Null"}
  "Token.gtype" = cluster{"type": "Type.gtype", "data": string, "offsets": i32[]}
  "JSON Tokens.gtype" = "Token.gtype"[]
  "Coersion Helper.gtype" = cluster{"T": u16, "D": string, "O": i32[]}[]
uses:
  JSONParser::Support::JSONParser.jsli::JSONTokenize
diagram:
  call "JSONTokenize"(jsonString=$"json string", error in=$"error in") -> (tokensJSON=w1, error out=w2)
  Unflatten From JSON(JSON string=w1, error in (no error)=w2, type and defaults="Coersion Helper.gtype" []) -> (error out=w3, value=w4)
  $"json tokens" <- w4
  $"error out" <- w3
