vi "index.gviweb"   [LabVIEW NXG 3.1.0]
panel controls:
  "Stop": bool
  "Listbox": i32 = -1
  "Set Locations": bool
  "Locations to set": T1[] = [{"latitude"=30.2643, "longitude"=-97.7393, "text"="Austin Convention Center"}, {"latitude"=30.2653, "longitude"=-97.7472, "text"="ACL Moody theatre"}, {"latitude"=30.269, "longitude"=-97.7421, "text"="Paramount Theatre"}]
types:
  T1 = cluster{"latitude": f64, "longitude": f64, "text": string}
uses:
  Leaflet::Leaflet.jsli::MapCreate
  Leaflet::Leaflet.jsli::MarkerDestroy
  Leaflet::Leaflet.jsli::MarkerCreate
  Leaflet::Leaflet.jsli::MarkerPopupShow
  Leaflet::Leaflet.jsli::MapDestroy
diagram:
  call "MapCreate"(selector=".leaflet-map", latitude=30.2672, longitude=-97.7431, zoom level=13) -> (map refnum=w1, error out=w2)
  s1 = w2  # shift register
  s2 = i32[] []  # shift register
  while {
    case (s1) {
      frame Error, Default {
        w3 = FALSE
        w4 = s1
        w5 = w1
        w6 = s2
      }
      frame No Error {
        event {
          on "Stop" Value changed {
            w3 = $Stop
            w4 = s1
            w5 = w1
            w6 = s2
          }
          on "Set Locations" Value changed {
            s3 = s1  # shift register
            for {
              w7 = each element of s2
              call "MarkerDestroy"(marker refnum=w7, error in=s3) -> (error out=w8)
              next s3 = w8
            }
            s4 = s3  # shift register
            for {
              w9 = each element of $"Locations to set"
              Property Node(instance in=w9) -> ("latitude"=w11, "longitude"=w12, "text"=w13)
              call "MarkerCreate"(map refnum=w1, latitude=w11, longitude=w12, text=w13, error in=s4) -> (marker refnum=w14, error out=w15)
              append w14 to w6
              append w13 to w10
              next s4 = w15
            }
            Property Node(instance in=reference to "Listbox", "Items"=w10)
            w3 = default
            w4 = s4
            w5 = w1
          }
          on "Listbox" Value changed {
            Is Greater Or Equal To 0(x=$Listbox) -> w16
            case (w16) {
              frame False, Default {
                w4 = s1
              }
              frame True {
                Array Index(array=s2) -> (out0[$Listbox]=w17)
                call "MarkerPopupShow"(arg=w17, error in=s1) -> (error out=w4)
              }
            }
            w3 = default
            w5 = w1
            w6 = s2
          }
        }
      }
    }
    Logical Or(w4, w3) -> w18
    next s1 = w4
    next s2 = w6
    stop if w18
  }
  call "MapDestroy"(map refnum=w5, error in=s1)
