vi "Destroy Map.gvi"   [LabVIEW NXG 4.0.0]
inputs:
  "error in": error
  "map reference": "map reference.gtype", required
outputs:
  "error out": error
types:
  "map reference.gtype" = i32
uses:
  GoogleMap::Support::GoogleMap.jsli::DestroyMap
diagram:
  call "DestroyMap"(mapReference=$"map reference") -> (error out=w1)
  Merge Errors($"error in", w1) -> (error out=w2)
  $"error out" <- w2
