vi "Destroy Marker.gvi"   [LabVIEW NXG 4.0.0]
inputs:
  "error in": error
  "marker reference": "marker reference.gtype", required
outputs:
  "error out": error
types:
  "marker reference.gtype" = i32
uses:
  GoogleMap::Support::GoogleMap.jsli::DestroyMarker
diagram:
  call "DestroyMarker"(markerReference=$"marker reference") -> (error out=w1)
  Merge Errors($"error in", w1) -> (error out=w2)
  $"error out" <- w2
