vi "Destroy Marker.gvi"   [LabVIEW NXG 4.0.0]
# Destroys a marker and removes it from the map
inputs:
  "marker reference": "marker reference.gtype", required
  "error in": error
outputs:
  "error out": error
types:
  "marker reference.gtype" = i32
uses:
  Leaflet::Support::Leaflet.jsli::MarkerDestroy
diagram:
  call "MarkerDestroy"(marker reference=$"marker reference") -> (error out=w1)
  Merge Errors($"error in", w1) -> (error out=w2)
  $"error out" <- w2
