vi "index.gviweb"   [G Web Development Software 22.0.0]
panel controls:
  "interval (ms)": f64 = 10
types:
  "data.gtype" = cluster{"x": f64, "y": f64}
uses:
  Perspective::Viewer::Viewer Create.gvi
  Perspective::Table::Table Create.gvi
  Perspective::Viewer::Viewer Load.gvi
  WebApp::Support::Show Error Dialog.gvi
  Perspective::Table::Table Update.gvi
diagram:
  call "Viewer Create.gvi"(container=reference to "view 1") -> (viewer reference=w1, error out=w2)
  call "Table Create.gvi"(schema="data.gtype" {all zero or empty}) -> (table reference=w3, error out=w4)
  call "Viewer Load.gvi"(viewer reference in=w1, table reference=w3, error in=w2) -> (error out=w5)
  call "Show Error Dialog.gvi"(error in=w5)
  s1 = w4  # shift register
  while (iteration -> i1) {
    Divide(x=i1, y=f64 default) -> w6
    Sine(x=w6) -> w7
    Multiply(w7, 10) -> w8
    Property Node(instance in="data.gtype" {all zero or empty}, "x"=i1, "y"=w8) -> (instance out=w9)
    Build Array(w9) -> w10
    call "Table Update.gvi"(table reference in=w3, data=w10, error in=s1) -> (error out=w11)
    Wait(time to wait=$"interval (ms)")
    next s1 = w11
    stop if w11
  }
  call "Show Error Dialog.gvi"(error in=s1)
