vi "index.gviweb"   [G Web Development Software 22.3.0]
panel controls:
  "update": bool
uses:
  Plotly::Create Plotly.gvi
  WebApp::MyPlot.jsli::MyPlot
diagram:
  call "Create Plotly.gvi"(container=reference to "plotly") -> (plot div reference=w1)
  while {
    event {
      on "update" Value changed {
        for (N = 1000) (iteration -> i1) {
          Random Number() -> (number (0 to 1)=w4)
          append i1 to w2
          append w4 to w3
        }
        call "MyPlot"(plotly div reference=w1, x=w2, y=w3)
      }
    }
    stop if FALSE
  }
  for (N = 10) (iteration -> i2) {
    append i2 to w5
  }
  call "MyPlot"(plotly div reference=w1, x=w5, y=w5)
