vi "Create Quill.gvi"   [LabVIEW NXG 3.1.0]
# Creates a Quill based rich text area.
# Use the supported formats input to enable the formats that will be possible in the quill editor.
# Use the hidden toolbar formats input to hide any of the enabled formats from the toolbar.
inputs:
  "selector": string, required
  "error in": error
  "supported formats": string[] = ["background", "bold", "color", "font", "code", "italic", "link", "size", "strike", "script", "underline", "blockquote", "header", "indent", "list", "align", "direction", "code-block", "formula", "image", "video", "clean"]
  "disabled": bool
  "hidden toolbar formats": string[]
outputs:
  "quill reference": "quill reference.gtype"
  "error out": error
types:
  "quill reference.gtype" = i32
uses:
  Quill::Support::Quill.jsli::CreateQuill
diagram:
  Flatten To JSON(anything=$"supported formats") -> (JSON string=w1)
  Flatten To JSON(anything=$"hidden toolbar formats") -> (JSON string=w2)
  call "CreateQuill"(selector=$selector, formatsJSON=w1, hiddenToolbarFormatsJSON=w2, disabled=$disabled, error in=$"error in") -> (quillReference=w3, error out=w4)
  $"quill reference" <- w3
  $"error out" <- w4
