vi "ckeditor.gviweb"   [LabVIEW NXG 3.1.0]
panel controls:
  "Submit": bool
panel indicators:
  "ckeditor input": string
  "ckeditor output": string
  "content": string
uses:
  CKEditor4::Create CKEditor.gvi
  CKEditor4::Get Content.gvi
  CKEditor4::Set Content.gvi
diagram:
  call "Create CKEditor.gvi"(disabled=TRUE, selector=".my-ckeditor-output") -> (ckeditor reference=w1, error out=w2)
  call "Create CKEditor.gvi"(selector=".my-ckeditor-input") -> (ckeditor reference=w3, error out=w4)
  while {
    event {
      on "Submit" Value changed {
        call "Get Content.gvi"(ckeditor reference in=w3, error in=w4) -> (content=w5)
        $content <- w5
        call "Set Content.gvi"(ckeditor reference in=w1, content=w5, error in=w2)
      }
    }
    stop if FALSE
  }
