vi "quill.gviweb"   [LabVIEW NXG 3.1.0]
panel controls:
  "submit": bool
panel indicators:
  "quill input": string
  "quill output": string
  "deltas json": string
uses:
  Quill::Create Quill.gvi
  Quill::Get Content.gvi
  Quill::Set Content.gvi
diagram:
  call "Create Quill.gvi"(selector=".my-quill-input") -> (quill reference=w1, error out=w2)
  call "Create Quill.gvi"(disabled=TRUE, selector=".my-quill-output") -> (quill reference=w3, error out=w4)
  while {
    event {
      on "submit" Value changed {
        call "Get Content.gvi"(quill reference in=w1, error in=w2) -> (deltas json=w5)
        $"deltas json" <- w5
        call "Set Content.gvi"(quill reference in=w3, deltas json=w5, error in=w4)
      }
    }
    stop if FALSE
  }
