vi "index.gviweb"   [LabVIEW NXG 3.1.0]
panel controls:
  "show dialog": bool
  "title": string = "This is an example title"
  "message": string = "This is a message describing the dialog"
  "icon": T2 = "success"
  "footer": string = "<a href=\"#\">Some additional information that may be helpful!</a>"
  "input text type": T3 = "none"
  "placeholder text": string = "Hey friend! enter a value!"
  "initial value": string = "A boring default value"
  "enable confirm button?": bool = TRUE
  "confirm button text": string = "OK"
  "confirm button background color": enum{"default", "red", "blue", "green"} = "default"
  "enable cancel button?": bool = TRUE
  "cancel button background color": enum{"default", "red", "blue", "green"} = "default"
  "cancel button text": string = "Cancel"
  "enable progress steps?": bool = TRUE
  "steps": cluster{"steps": string}[] = [{"steps"="😁"}, {"steps"="😀"}, {"steps"="😅"}, {"steps"="😆"}, {"steps"="😍"}]
  "current steps index": i32 = 1
  "animation?": bool = TRUE
  "backdrop?": bool = TRUE
  "Prompt": bool
  "prompt message": string = "This is a simple prompt!"
  "prompt default": string = "one nice default"
panel indicators:
  "dismiss reason": T1
  "value": string
  "prompt value": string
  "prompt cancelled?": bool
types:
  T1 = enum{"unknown", "success", "backdrop", "cancel", "close", "esc", "timer"}
  T2 = enum{"none", "success", "info", "question", "warning", "error"}
  T3 = enum{"none", "text", "email", "password", "number", "tel", "textarea", "url"}
uses:
  SweetAlert::Advanced::Configure::Base Options.gvi
  SweetAlert::Advanced::Configure::Input Text Options.gvi
  SweetAlert::Advanced::Configure::Confirm Button Options.gvi
  SweetAlert::Advanced::Configure::Cancel Button Options.gvi
  SweetAlert::Advanced::Configure::Progress Steps Options.gvi
  SweetAlert::Advanced::Operate::Open Sweet Alert.gvi
  SweetAlert::Prompt.gvi
diagram:
  while {
    event {
      on "show dialog" Value changed {
        call "Base Options.gvi"(footer=$footer, title=$title, message=$message, icon=$icon, animation?=$"animation?", backdrop?=$"backdrop?") -> (options out=w1)
        call "Input Text Options.gvi"(options in=w1, input text type=$"input text type", placeholder text=$"placeholder text", initial value=$"initial value") -> (options out=w2)
        case ($"confirm button background color") {
          frame "red" {
            w3 = 4294748303
          }
          frame "blue" {
            w3 = 4287870947
          }
          frame "green" {
            w3 = 4291488412
          }
          frame "default" {
            w3 = 4281370070
          }
        }
        call "Confirm Button Options.gvi"(options in=w2, enable?=$"enable confirm button?", text=$"confirm button text", background color=w3) -> (options out=w4)
        case ($"cancel button background color") {
          frame "red" {
            w5 = 4294748303
          }
          frame "blue" {
            w5 = 4287870947
          }
          frame "green" {
            w5 = 4291488412
          }
          frame "default" {
            w5 = 4289374890
          }
        }
        call "Cancel Button Options.gvi"(options in=w4, enable?=$"enable cancel button?", text=$"cancel button text", background color=w5) -> (options out=w6)
        for {
          w7 = each element of $steps
          Property Node(instance in=w7) -> ("steps"=w9)
          append w9 to w8
        }
        case ($"enable progress steps?") {
          frame False, Default {
            w10 = w6
          }
          frame True {
            call "Progress Steps Options.gvi"(options in=w6, progress steps=w8, progress index=$"current steps index") -> (options out=w10)
          }
        }
        call "Open Sweet Alert.gvi"(options=w10) -> (dismiss reason=w11, value=w12)
        $"dismiss reason" <- w11
        $value <- w12
      }
      on "Prompt" Value changed {
        call "Prompt.gvi"(message=$"prompt message", default=$"prompt default") -> (value=w13, cancelled?=w14)
        $"prompt value" <- w13
        $"prompt cancelled?" <- w14
      }
    }
    stop if FALSE
  }
