vi "index.gviweb"   [G Web Development Software 21.0.0]
panel controls:
  "achievment1": bool
  "achievment2": bool
  "lose1": bool
  "lose2": bool
  "win1": bool
  "win2": bool
  "start": bool
panel indicators:
  "time": waveform<f64>
  "frequency": waveform<f64>
uses:
  WebAudio::AudioNodes::Create Media Stream Audio Source Node.gvi
  WebAudio::Analyser::Create Analyzer.gvi
  WebAudio::Analyser::Get Analyser Frequency Data.gvi
  WebAudio::Analyser::Get Analyser Time Domain Data.gvi
  WebAudio::Buffers::Create Audio Buffer From URL.gvi
  WebAudio::AudioNodes::Get Audio Destination Node.gvi
  WebAudio::Buffers::Play Audio Buffer.gvi
diagram:
  # The user must interact with the page for the Web Audio API to start by clicking, touching, user keyboard, etc. We accomplish that by only playing sounds on button clicks.
  event {
    on "start" Value changed {
      call "Create Media Stream Audio Source Node.gvi"() -> (audio node reference=w1, error out=w2)
    }
  }
  call "Create Analyzer.gvi"(audio node reference=w1, error in=w2) -> (analyser reference=w3, error out=w4)
  s1 = w4  # shift register
  while {
    Wait(time to wait=10)
    call "Get Analyser Frequency Data.gvi"(analyser reference=w3, error in=s1) -> (frequency data=w5, error out=w6)
    $frequency <- w5
    call "Get Analyser Time Domain Data.gvi"(analyser reference=w3, error in=w6) -> (time domain data=w7, error out=w8)
    $time <- w7
    next s1 = w8
    stop if w8
  }
  Property Node(instance in=s1) -> ("source"=w9)
  One Button Dialog(message=w9)
  call "Create Audio Buffer From URL.gvi"(url="Support/270333__littlerobotsoundfactory__jingle-win-00.wav") -> (audio buffer reference=w10, error out=w11)
  call "Create Audio Buffer From URL.gvi"(url="Support/270319__littlerobotsoundfactory__jingle-win-01.wav") -> (audio buffer reference=w12, error out=w13)
  w14 = "Support/270329__littlerobotsoundfactory__jingle-lose-00.wav"
  call "Create Audio Buffer From URL.gvi"(url=w14) -> (audio buffer reference=w15, error out=w16)
  w17 = "Support/270334__littlerobotsoundfactory__jingle-lose-01.wav"
  call "Create Audio Buffer From URL.gvi"(url=w17) -> (audio buffer reference=w18, error out=w19)
  w20 = "Support/270331__littlerobotsoundfactory__jingle-achievement-00.wav"
  call "Create Audio Buffer From URL.gvi"(url=w20) -> (audio buffer reference=w21, error out=w22)
  w23 = "Support/270330__littlerobotsoundfactory__jingle-achievement-01.wav"
  call "Create Audio Buffer From URL.gvi"(url=w23) -> (audio buffer reference=w24, error out=w25)
  Build Array(w10, w12, w15, w18, w21, w24) -> w26
  Merge Errors(w11, w13, w16, w19, w22, w25) -> (error out=w27)
  call "Get Audio Destination Node.gvi"(error in=w27) -> (destination audio node reference=w28, error out=w29)
  s2 = w29  # shift register
  while {
    event {
      on "achievment1" Value changed; "achievment2" Value changed; "lose1" Value changed; "lose2" Value changed; "win1" Value changed; "win2" Value changed {
        Event Data() -> ("Index"=w31)
        Array Index(array=w26) -> (out0[w31]=w32)
        call "Play Audio Buffer.gvi"(audio buffer reference=w32, destination audio node reference=w28, error in=s2) -> (error out=w30)
      }
    }
    next s2 = w30
    stop if w30
  }
  Property Node(instance in=s2) -> ("source"=w33)
  One Button Dialog(message=w33)
