vi "BatteryLevel.gviweb"   [LabVIEW NXG 3.1.0]
panel controls:
  "connect to battery": bool
panel indicators:
  "value": u8[]
  "id": string
  "name": string
uses:
  WebBluetooth::UUID::Service UUID (String).gvi
  WebBluetooth::Filter::Set Filter Services.gvi
  WebBluetooth::Request Device.gvi
  WebBluetooth::GATT Server Connect.gvi
  WebBluetooth::Get Primary Service.gvi
  WebBluetooth::UUID::Characteristic UUID (String).gvi
  WebBluetooth::Get Characteristic.gvi
  WebBluetooth::Read Value.gvi
  WebBluetooth::GATT Server Disconnect.gvi
diagram:
  while {
    event {
      on "connect to battery" Value changed {
        call "Service UUID (String).gvi"(name="battery_service") -> (uuid=w2)
        Build Array(w2) -> w3
        call "Set Filter Services.gvi"(service uuids=w3) -> (filter out=w4)
        Build Array(w4) -> w5
        call "Request Device.gvi"(filters=w5) -> (device reference=w6, id=w7, name=w8, error out=w9)
        call "GATT Server Connect.gvi"(device reference in=w6, error in=w9) -> (device reference out=w10, error out=w11)
        call "Service UUID (String).gvi"(name="battery_service") -> (uuid=w12)
        call "Get Primary Service.gvi"(device reference=w10, service uuid=w12, error in=w11) -> (service reference=w13, error out=w14)
        call "Characteristic UUID (String).gvi"(name="battery_level") -> (uuid=w15)
        call "Get Characteristic.gvi"(service reference=w13, characteristic uuid=w15, error in=w14) -> (characteristic reference=w16, error out=w17)
        sequence {
          frame 0 {
            call "Read Value.gvi"(characteristic reference=w16, error in=w17) -> (value=w18, error out=w19)
            $value <- w18
          }
        }
        call "GATT Server Disconnect.gvi"(device reference=w6, error in=w19) -> (error out=w1)
        $id <- w7
        $name <- w8
      }
    }
    stop if w1
  }
  Property Node(instance in=w1) -> ("source"=w20)
  One Button Dialog(message=w20)
