vi "Dotti.gviweb"   [LabVIEW NXG 3.1.0]
panel controls:
  "Connect": bool
  "one": u32
uses:
  WebApp::Support::Set Row Color.gvi
  WebBluetooth::Write Value.gvi
  WebBluetooth::UUID::Service UUID (String).gvi
  WebBluetooth::Filter::Set Filter Name Prefix.gvi
  WebBluetooth::Request Device.gvi
  WebBluetooth::GATT Server Connect.gvi
  WebBluetooth::Get Primary Service.gvi
  WebBluetooth::UUID::Characteristic UUID (String).gvi
  WebBluetooth::Get Characteristic.gvi
diagram:
  s1 = uninitialised  # shift register
  while {
    event {
      on "one" Value changed {
        Event Data() -> ("New Value"=w3)
        for (N = 8) (iteration -> i1) {
          Is Less(x=w3, y=i1) -> w4
          Select(s=w4, t=4278190080, f=4293794853) -> w5
          Decrement(x=8) -> w6
          Subtract(x=w6, y=i1) -> w7
          call "Set Row Color.gvi"(row number=w7, color=w5) -> (message=w8)
          call "Write Value.gvi"(characteristic reference=s1, value=w8) -> (error out=w1)
          stop if w1
        }
        w2 = s1
      }
      on "Connect" Value changed {
        call "Service UUID (String).gvi"(name="0000fff0-0000-1000-8000-00805f9b34fb") -> (uuid=w9)
        Property Node(instance in=reference to "Connect", "Text"=["connecting"], "Disabled"=TRUE) -> (error out=w10)
        call "Set Filter Name Prefix.gvi"(name prefix="Dotti") -> (filter out=w11)
        Build Array(w11) -> w12
        Build Array(w9) -> w13
        call "Request Device.gvi"(optional service uuids=w13, filters=w12, error in=w10) -> (device reference=w14, error out=w15)
        call "GATT Server Connect.gvi"(device reference in=w14, error in=w15) -> (device reference out=w16, error out=w17)
        call "Get Primary Service.gvi"(device reference=w16, service uuid=w9, error in=w17) -> (service reference=w18, error out=w19)
        call "Characteristic UUID (String).gvi"(name="0000fff3-0000-1000-8000-00805f9b34fb") -> (uuid=w20)
        call "Get Characteristic.gvi"(service reference=w18, characteristic uuid=w20, error in=w19) -> (characteristic reference=w2, error out=w21)
        Property Node(instance in=reference to "Connect", "Text"=["connected"], error in=w21) -> (error out=w1)
      }
    }
    next s1 = w2
    stop if w1
  }
  Property Node(instance in=w1) -> ("source"=w22)
  One Button Dialog(message=w22)
