vi "Request Device.gvi"   [LabVIEW NXG 5.0.0]
inputs:
  "filters": "filters.gtype"
  "accept all devices": bool
  "optional service uuids": "uuid.gtype"[]
  "error in": error
outputs:
  "error out": error
  "device reference": "device reference.gtype"
types:
  "filters.gtype" = cluster{"filterParts": string[]}[]
  "uuid.gtype" = string
  "device reference.gtype" = "NI.JavaScriptReference"
uses:
  WebBluetooth::Support::WebBluetooth.jsli::RequestDevice
diagram:
  Flatten To Json(anything=$filters) -> (JSON string=w1)
  Flatten To Json(anything=$"optional service uuids") -> (JSON string=w2)
  call "RequestDevice"(filtersJSON=w1, acceptAllDevices=$"accept all devices", optionalServiceUUIDsJSON=w2, error in=$"error in") -> (device=w3, error out=w4)
  $"device reference" <- w3
  $"error out" <- w4
