vi "main.gviweb"   [LabVIEW NXG 3.1.0]
uses:
  Console::Console Log.gvi
  Express::Run Express Application.gvi
diagram:
  call "Console Log.gvi"(message="Starting Express application...") -> (error out=w1)
  call "Run Express Application.gvi"(error in=w1) -> (error out=w2)
  call "Console Log.gvi"(message="Finished starting Express application.", error in=w2)
