vi "webvi-devtools-panel.gviweb"   [LabVIEW NXG 3.1.0]
panel controls:
  "allow updates": bool = TRUE
panel indicators:
  "updates loop count": i32
  "messages": cluster{"path": string, "value": string}[]
uses:
  WebVIDevToolsChrome::Support::WebVIDevTools.jsli::WaitForEvent
  JSONTree::Convert to JSON Tree.gvi
diagram:
  while (iteration -> i1) {
    case ($"allow updates") {
      frame False, Default { }
      frame True {
        call "WaitForEvent"() -> (eventData=w1, error out=w2)
        call "Convert to JSON Tree.gvi"(json=w1, error in=w2) -> (json tree=w3, error out=w4)
        case (w4) {
          frame Error, Default { }
          frame No Error {
            $messages <- w3
          }
        }
      }
    }
    Wait(time to wait=10)
    $"updates loop count" <- i1
    stop if FALSE
  }
