vi "main.gviweb"   [LabVIEW NXG 5.1.0]
uses:
  NI::G Core::Operating System::Write to System Log.gvi
  WebVINodePath::Get Component Directory.gvi
  NI::WebSockets::Open WebSocket.gvi
  NI::WebSockets::Write String.gvi
  NI::WebSockets::Read String.gvi
  NI::WebSockets::Close WebSocket.gvi
diagram:
  call "Write to System Log.gvi"(message="Starting WebSocket connection...") -> (error out=w1)
  call "Get Component Directory.gvi"(error in=w1) -> (working directory=w2, error out=w3)
  call "Write to System Log.gvi"(message=w2, error in=w3) -> (error out=w4)
  To Variant(anything="Whats up") -> w5
  Variant To Data(error in (no error)=w4, type=string "", variant=w5) -> (data=w6, error out=w7)
  call "Write to System Log.gvi"(message=w6, error in=w7) -> (error out=w8)
  call "Open WebSocket.gvi"(url="wss://echo.websocket.org/?encoding=text", error in=w8) -> (websocket session out=w9, error out=w10)
  call "Write String.gvi"(websocket session in=w9, string message="Echooo", error in=w10) -> (websocket session out=w11, error out=w12)
  call "Read String.gvi"(websocket session in=w11, timeout=3, error in=w12) -> (websocket session out=w13, string response=w14, error out=w15)
  call "Close WebSocket.gvi"(websocket session in=w13, error in=w15) -> (error out=w16)
  call "Write to System Log.gvi"(message=w14, error in=w16) -> (error out=w17)
  call "Write to System Log.gvi"(message="Finished WebSocket connection.", error in=w17)
